# Grasshopper definition animation_piton.ghx (Grasshopper 1.0.7)

python = GhPythonScript()  # -> Out, A
python_2 = GhPythonScript()  # -> Out, A
python_3 = GhPythonScript()  # -> Out, A
python_4 = GhPythonScript()  # -> Out, A
toggle = BooleanToggle(True)
int = Integer("200")
interval = Domain(int)
timer = Timer(TimerInterval=60, Target=c_script)
c_script = CSharpScript(reset=toggle)  # -> out, B, C, state; inputs reset: Boolean
# ---------- c_script: C# usings ----------
using System.IO;
using System.Linq;
using System.Data;
using System.Drawing;
using System.Reflection;
using System.Windows.Forms;
using System.Xml;
using System.Xml.Linq;
using System.Runtime.InteropServices;

using Rhino.DocObjects;
using Rhino.Collections;
using GH_IO;
using GH_IO.Serialization;
# ---------- c_script: C# ----------
    if(!reset){
      c++;
    }else{
      c = -1;
    }
    c = (int) (c % (201));
    if(c <= 200){
      B = true;
    }else{
      B = false;
    }


    C = c;
    if(!reset)
    {
      state = 1;
    }
    else
    {
      state = 0;
    }
# ---------- c_script: C# additional code ----------
  int c = -1;
# ---------- end c_script ----------
bool = Boolean(toggle)
pt = Point(Point(13.87665217, 8.80552754, 0))
python_5 = GhPythonScript(initial=pt, active=bool, x=c_script.C)  # -> a; inputs initial: Point3d
# ---------- python_5: Python ----------
from ghpythonlib.componentbase import executingcomponent as component
import Grasshopper, GhPython
import System
import Rhino
import rhinoscriptsyntax as rs
from Rhino.Geometry import Point3d, Vector3d,Point3f,Vector3f
import random


class MyComponent(component):
    initiated = None
    myPos = None
    speed = 1
    destination = None
    counter = 0
    
    moveDir = None
    destReached = None
    
    curWaitFrame = None
    initialX = 0
    initialY = 0
    initialZ = 0
    
    def __init__(self):
        self.initiated = False
        self.myPos = Point3f(0,0,0)
        self.destination = Point3f(0,0,0)
        self.moveDir = Vector3f(0,0,0)
        self.destReached = True
        self.curWaitFrame = 0
        self.initialX = 0
        self.initialY = 0
        self.initialZ = 0
    
    def RunScript(self, initial, active, x):
        a = None
        """Provides a scripting component.
            Inputs:
                x: The x script variable
                y: The y script variable
            Output:
                a: The a output variable"""
        
        __author__ = "andri.setiawan"
        __version__ = "2020.03.13"
        
        import rhinoscriptsyntax as rs
        import scriptcontext as sc
        
        print active
        if (not self.initiated) or (active):
            if not self.initiated:
                self.initialX = initial.X
                self.initialY = initial.Y
                self.initialZ = initial.Z
                self.initiated = True
                #rh.RhinoDoc.ActiveDoc.Objects.Delete(initial,True)
                #rs.DeleteObject(initial)
            #print ("counter %d in %s r %s" %(self.counter,self.initiated,active))
            self.counter+=1
            self.myPos.X = self.initialX
            self.myPos.Y = self.initialY
            self.myPos.Z = self.initialZ
            self.destReached = True
        else:
            if self.destReached:
                if self.curWaitFrame < 20:
                    self.curWaitFrame += 1
                else:
                    self.curWaitFrame = 0
                    self.makeNewDestination()
                    print ("new destination %d %d %d "%(self.destination.X,self.destination.Y,self.destination.Y))
            else:
                distance = self.myPos.DistanceTo(self.destination)
                if distance > 1:
                    self.myPos = rs.PointAdd(self.myPos,self.moveDir)
                else:
                    self.myPos = self.destination
                    self.destReached  = True
        print ("pn %d %d %d %d" %(self.myPos.X,self.myPos.Y,self.myPos.Z,x))
        print ("modir %d %d %d %d" %(self.moveDir.X,self.moveDir.Y,self.moveDir.Z,x))
        print ("destination %d %d %d "%(self.destination.X,self.destination.Y,self.destination.Y))
                        
                        
                
        a = self.myPos
        initial.X = self.myPos.X
        initial.Y = self.myPos.Y
        initial.Z = self.myPos.Z
        
        # return outputs if you have them; here I try it for you:
        return a

    def makeNewDestination(self):
        from Rhino.Geometry import Point3d, Vector3d,Point3f,Vector3f
        import random
        self.destination = Point3f(random.randint(-100,100),random.randint(-100,100),random.randint(-100,100))
        
        self.moveDir = Vector3f.Subtract(Vector3f(self.destination.X,self.destination.Y,self.destination.Z),Vector3f(self.myPos.X,self.myPos.Y,self.myPos.Z))
        #length = Vector3d.Divide(
        self.moveDir = Vector3f.Divide(self.moveDir,self.moveDir.Length)
        self.destReached = False
# ---------- end python_5 ----------
